# Grasshopper definition leland.ghx (Grasshopper 1.0.7)

# ---- group: RH_IN:106:0001
txt = Text()

# ----
chars = Characters(Text=txt)  # -> Result, Unicode
rev = ReverseList(List=chars.Result)
join = TextJoin(Text=rev)

# ---- group: RH_OUT:106:out_text
txt_2 = Text(join)
