# Grasshopper definition workshop_step5.ghx (Grasshopper 1.0.7)

circle = Circle({Plane=PlaneXY(0, 0, 0), Radius=5})  # disabled
panel = Panel("110")  # disabled
Z = UnitZ(Factor=Slider(15, range=0..100))

# ---- group: RH_IN:rotate
num = Number(panel)

# ---- group: RH_IN:curve
crv = Curve(circle)

# ----
move = Move(Geometry=crv, Motion=Z)  # -> Geometry, Transform
rad = Radians(Degrees=num)
rotate = Rotate(Geometry=move.Geometry, Angle=rad, Plane=PlaneXY(0, 0, 0))  # -> Geometry, Transform
divide = DivideCurve(Curve=crv, Count=10, Kinks=False)  # -> Points, Tangents, Parameters
divide_2 = DivideCurve(Curve=rotate.Geometry, Count=10, Kinks=False)  # -> Points, Tangents, Parameters
ln = Line(StartPoint=divide.Points, EndPoint=divide_2.Points)

# ---- group: RH_OUT:lines
crv_2 = Curve(ln)
